# Dynamo graph 0 ReArtsy Добавить общие параметры.dyn (Dynamo 2.0.3.8810)

file_path = Filename(".\ReArtsy_Params_List.txt")  # graph input
importCSV = Data.ImportCSV(filePath=file_path)
code_block = CodeBlock(list=importCSV) { list[0]; }
sharedParameterFile = Parameter.SharedParameterFile()
parse = Custom[SharedParameterFile.Parse](path=sharedParameterFile)  # Returns all parameters from a shared parameter file.
code_block_2 = CodeBlock()
# ---------- code_block_2.designscript (5 lines) ----------
{"TEXT":"Text",
"MULTILINETEXT":"MultilineText",
"INTEGER":"Integer",
"NUMBER":"Number",
"URL":"URL"};
# ----------------------------------------
code_block_3 = CodeBlock(ngroup=parse.groups, dtdic=code_block_2, type=parse.data_types) { [ngroup, dtdic[type]]; }
transpose = List.Transpose(lists=code_block_3)
byKeysValues = DesignScript.Builtin.Dictionary.ByKeysValues(keys=parse.names, values=transpose)
valueAtKey = DesignScript.Builtin.Dictionary.ValueAtKey(dictionary=byKeysValues, key=code_block)
code_block_4 = CodeBlock { 0; }
getItemAtIndex = List.GetItemAtIndex(list=valueAtKey@L2, index=code_block_4)
code_block_5 = CodeBlock { 1; }
getItemAtIndex_2 = List.GetItemAtIndex(list=valueAtKey@L2, index=code_block_5)
select_builtin_parameter_group = BuiltInParameterGroup(index=26)
boolean = BoolSelector(true)
categories = Categories(index=372)
addSharedParameter = Orchid.RevitProject.Parameters.Parameter.AddSharedParameter(parameterName=code_block, groupName=getItemAtIndex, type=getItemAtIndex_2, group=select_builtin_parameter_group, instance=boolean, category=categories, lacing=Longest)
added_parameters = Watch(addSharedParameter)  # graph output
code_block_6 = CodeBlock(w=parse.names) { w; }
